% Simulink data dictionary enoder_dictionary.sldd

hal_result_enum_t = enum(DefaultValue="hal_res_OK", StorageType="int16")
  hal_res_OK = 0
  hal_res_NOK_generic = -1

aksim2_error_type = enum(DefaultValue="aksim2_error_none", StorageType="int8")
  aksim2_error_none = 0
  aksim2_error_invalid_data = 1
  aksim2_error_close_to_limit = 2
  aksim2_error_crc = 4

encoder_error_type_t = enum(DefaultValue="encoder_error_none", StorageType="int8")
  encoder_error_none = 0
  encoder_error_hal = 1
  encoder_error_crc = 2
  encoder_error_invalid_data = 3
  encoder_error_close_to_limit = 4